# Dynamo graph PlaceraBlock_2.dyn (Dynamo 2.5.1.7586)

current = Autodesk.AutoCAD.DynamoNodes.Document.Current()
string = StringInput("7--spp 0290607")
blockByName = Autodesk.AutoCAD.DynamoNodes.Document.BlockByName(document=current, name=string)
code_block = CodeBlock { "A_B"; }
corridorByName = Autodesk.Civil.DynamoNodes.Selection.CorridorByName(name=code_block, document=current)
baselines = Autodesk.Civil.DynamoNodes.Corridor.Baselines(corridor=corridorByName)
firstItem = List.FirstItem(list=baselines)  # frozen
code_block_2 = CodeBlock { "Sliper_CL_N"; }
corridorFeatureLinesByCode = Autodesk.Civil.DynamoNodes.Baseline.CorridorFeatureLinesByCode(baseline=firstItem, code=code_block_2)
startStation = Autodesk.Civil.DynamoNodes.CorridorFeatureLine.StartStation(corridorFeatureLine=corridorFeatureLinesByCode)
endStation = Autodesk.Civil.DynamoNodes.CorridorFeatureLine.EndStation(corridorFeatureLine=corridorFeatureLinesByCode)
number_slider = DoubleSlider(0.6, range=0..3 step 0.1)
range = Range(start=startStation, end=endStation, step=number_slider)
boolean = BoolSelector(false)
coordinateSystemByStation = Autodesk.Civil.DynamoNodes.CorridorFeatureLine.CoordinateSystemByStation(station=range, vertical=boolean)  # unwired: corridorFeatureLine
origin = CoordinateSystem.Origin(coordinateSystem=coordinateSystemByStation)
ZAxis = CoordinateSystem.ZAxis(coordinateSystem=coordinateSystemByStation)
XAxis = Vector.XAxis()
YAxis = CoordinateSystem.YAxis(coordinateSystem=coordinateSystemByStation)
ZAxis_2 = Vector.ZAxis()
angleAboutAxis = Vector.AngleAboutAxis(vector=XAxis, otherVector=YAxis, rotationAxis=ZAxis_2)
code_block_3 = CodeBlock(a=angleAboutAxis) { a + [0]; }
code_block_4 = CodeBlock { 1; }
scale = CoordinateSystem.Scale(coordinateSystem=coordinateSystemByStation, xamount=code_block_4, yamount=code_block_4, zamount=code_block_4)
scaleFactor = CoordinateSystem.ScaleFactor(coordinateSystem=scale)
string_2 = StringInput("JVG")
modelSpace = Autodesk.AutoCAD.DynamoNodes.Document.ModelSpace(document=current)
create = Autodesk.AutoCAD.DynamoNodes.BlockReference.Create(sourceBlock=blockByName, position=origin, normal=ZAxis, rotationDegrees=code_block_3, scaleFactors=scaleFactor, layer=string_2, block=modelSpace)
string_3 = StringInput("7--spp 0290607")
blockByName_2 = Autodesk.AutoCAD.DynamoNodes.Document.BlockByName(document=current, name=string_3)
corridorByName_2 = Autodesk.Civil.DynamoNodes.Selection.CorridorByName(name=code_block, document=current)  # frozen
baselines_2 = Autodesk.Civil.DynamoNodes.Corridor.Baselines(corridor=corridorByName_2)
firstItem_2 = List.FirstItem(list=baselines_2)
code_block_5 = CodeBlock { "CL_U"; }
corridorFeatureLinesByCode_2 = Autodesk.Civil.DynamoNodes.Baseline.CorridorFeatureLinesByCode(baseline=firstItem_2, code=code_block_5)
watch = Watch(corridorFeatureLinesByCode_2)
startStation_2 = Autodesk.Civil.DynamoNodes.CorridorFeatureLine.StartStation(corridorFeatureLine=corridorFeatureLinesByCode_2)
endStation_2 = Autodesk.Civil.DynamoNodes.CorridorFeatureLine.EndStation(corridorFeatureLine=corridorFeatureLinesByCode_2)
number_slider_2 = DoubleSlider(0.6, range=0..3 step 0.1)
range_2 = Range(start=startStation_2, end=endStation_2, step=number_slider_2)
coordinateSystemByStation_2 = Autodesk.Civil.DynamoNodes.CorridorFeatureLine.CoordinateSystemByStation(corridorFeatureLine=watch, station=range_2)
origin_2 = CoordinateSystem.Origin(coordinateSystem=coordinateSystemByStation_2)
ZAxis_3 = CoordinateSystem.ZAxis(coordinateSystem=coordinateSystemByStation_2)
XAxis_2 = Vector.XAxis()
YAxis_2 = CoordinateSystem.YAxis(coordinateSystem=coordinateSystemByStation_2)
ZAxis_4 = Vector.ZAxis()
angleAboutAxis_2 = Vector.AngleAboutAxis(vector=XAxis_2, otherVector=YAxis_2, rotationAxis=ZAxis_4)
code_block_6 = CodeBlock(a=angleAboutAxis_2) { a + [0]; }
code_block_7 = CodeBlock { 1; }
scale_2 = CoordinateSystem.Scale(coordinateSystem=coordinateSystemByStation_2, xamount=code_block_7, yamount=code_block_7, zamount=code_block_7)
scaleFactor_2 = CoordinateSystem.ScaleFactor(coordinateSystem=scale_2)
string_4 = StringInput("JVG")
modelSpace_2 = Autodesk.AutoCAD.DynamoNodes.Document.ModelSpace(document=current)
create_2 = Autodesk.AutoCAD.DynamoNodes.BlockReference.Create(sourceBlock=blockByName_2, position=origin_2, normal=ZAxis_3, rotationDegrees=code_block_6, scaleFactors=scaleFactor_2, layer=string_4, block=modelSpace_2)
YAxis_3 = Vector.YAxis()
